# Grasshopper definition unnamed.gh (Grasshopper 1.0.7)

path = FilePath("/Users/duch/Documents/Github/compas_knit/src/cpp_libigl/build/temp/output.txt")
path_2 = FilePath("/Users/duch/Documents/Github/compas_knit/temp/edge_st")  # disabled
path_3 = FilePath("/Users/duch/Documents/Github/compas_knit/temp/edge_ed")  # disabled
python = GhPythonScript(file_st=path_2, file_ed=path_3)  # -> out, temp_geo; disabled
# ---------- python: Python ----------
__author__ = "duch"

import rhinoscriptsyntax as rs
import os
import json
import Rhino.Geometry as rg


with open(file_st, 'r') as json_file:
    sts = json.load(json_file)

with open(file_ed, 'r') as json_file:
    eds = json.load(json_file)


temp_geo = []
for i, (st, ed) in enumerate(zip(sts, eds)):
    st_pt = rg.Point3d(*st)
    ed_pt = rg.Point3d(*ed)
    
    line = rg.Line(st_pt, ed_pt)
    temp_geo.append(line)
# ---------- end python ----------
python_2 = GhPythonScript(file=path)  # -> out, pts, temp_geo, txts
# ---------- python_2: Python ----------
__author__ = "duch"

import rhinoscriptsyntax as rs
import os
import json
import Rhino.Geometry as rg

print(file)
with open(file, "r") as i_file:
    # read xyzs 
    line = i_file.readline().strip()
    pts = []

    while line:
        if not line:
            break
            
        xyz = line.split()
        xyz = [float(x) for x in xyz] # turn string to float
        pts.append(rg.Point3d(*xyz))
        
        line = i_file.readline().strip()
        
        
    # read edges
    line = i_file.readline().strip()
    edges = []
    while line:
        if not line:
            break

        uv = line.split()
        uv = [int(x) for x in uv] # turn string to integer
        edges.append(uv)
        
        line = i_file.readline().strip()
        
    # read distances
    line = i_file.readline().strip()
    dis = []
    dict_edges = {}
    while line:
        if not line:
            break
            
        dis.append(int(line))
        if int(line) not in dict_edges.keys():
            dict_edges[int(line)] = []
        line = i_file.readline().strip()
        

temp_geo = []


for i, (u, v) in enumerate(edges):
    u_pt = pts[u]
    v_pt = pts[v]
    line = rg.Line(u_pt, v_pt)
    dict_edges[dis[i]].append(line.ToNurbsCurve())

txts = []
for key in dict_edges.keys():
    joined_crv = rg.Curve.JoinCurves(dict_edges[key])
    if len(joined_crv) >= 2: 
        for crv in joined_crv:
            length = crv.GetLength()
            if length <= 0.001:
                pass
            else:
                temp_geo.append(crv)
                txts.append(key)
    else:
        temp_geo.extend(joined_crv)
        txts.append(key)
# ---------- end python_2 ----------
pt = Point(python_2.pts)
geo = Geometry(python_2.temp_geo)
end = EndPoints(Curve=python.temp_geo)  # -> Start, End; disabled
number_slider = Slider(61, range=0..61)  # disabled
join = JoinCurves(Curves=python.temp_geo, Preserve=False)  # disabled
fit = FitCurve()
end_2 = EndPoints(Curve=geo)  # -> Start, End
redpline = Reduce(Tolerance=1)  # -> Polyline, Reduction
python_3 = GhPythonScript()
# ---------- python_3: Python ----------
__author__ = "duchaoyu"

import rhinoscriptsyntax as rs
import scriptcontext as sc
import Rhino.Geometry as rg
from compas.datastructures import Mesh
from compas.geometry import centroid_points
from compas.utilities import pairwise

def point_to_R(point):
    x= point[0]
    y = point[1]
    z = point[2]
    return rg.Point3d(x, y, z)

def vector_to_R(vector):
    x = vector[0]
    y = vector[1]
    z = vector[2]
    return rg.Vector3d(x, y, z)

def line_to_R(line):
    st = line[0]
    ed = line[1]
    st_pt = rg.Point3d(st[0], st[1], st[2])
    ed_pt = rg.Point3d(ed[0], ed[1], ed[2])
    return rg.Line(st_pt, ed_pt)

def polygon_to_R(polygon):
    if isinstance(polygon, list):
        points = polygon
    else:
        points = polygon.points
    R_points = []
    for pt in points:
        R_pt = rg.Point3d(pt[0], pt[1], pt[2])
        R_points.append(R_pt)
    R_points.append(rg.Point3d(points[0][0], points[0][1], points[0][2]))
    return rg.Polyline(R_points)

def polyline_to_R(polyline):
    if isinstance(polyline, list):
        points = polyline
    else:
        points = polyline.points
    R_points = []
    for pt in points:
        R_pt = rg.Point3d(pt[0], pt[1], pt[2])
        R_points.append(R_pt)
    R_points.append(rg.Point3d(points[0][0], points[0][1], points[0][2]))
    return rg.Polyline(R_points)

def circle_to_R(circle):
    p = circle.plane
    r = circle.radius
    origin = rg.Point3d(p.point[0], p.point[1], p.point[2])
    normal = rg.Vector3d(p.normal[0], p.normal[1], p.normal[2])
    return rg.Circle(rg.Plane(origin, normal), r)

def plane_to_R(plane):
    pt = plane[0]
    normal = plane[1]
    return rg.Plane(rg.Point3d(*pt), rg.Vector3d(*normal))

def mesh_to_R(mesh):
    R_mesh = rg.Mesh()
    key_count_dict = {}
    count = 0
    for vkey in mesh.vertices():
        x, y, z = mesh.vertex_coordinates(vkey)
        R_mesh.Vertices.Add(rg.Point3d(x, y, z))
        key_count_dict[vkey] = count
        count += 1
    for fkey in mesh.faces():
        f_vkeys = mesh.face_vertices(fkey)
        if len(f_vkeys) <= 4:
            f_vkeys = [key_count_dict[key] for key in f_vkeys]
            R_mesh.Faces.AddFace(*f_vkeys)
        else:
            centroid = centroid_points([mesh.vertex_coordinates(vkey) for vkey in f_vkeys])
            c = R_mesh.Vertices.Add(rg.Point3d(*centroid))
            facets = []
            f_vkeys = [key_count_dict[key] for key in f_vkeys]
            for i, j in pairwise(f_vkeys + f_vkeys[:1]):
                facets.append(R_mesh.Faces.AddFace(i, j, c))
            ngon = rg.MeshNgon.Create(f_vkeys, facets)
            R_mesh.Ngons.AddNgon(ngon)
    R_mesh.Normals.ComputeNormals()
    R_mesh.Compact()
    return R_mesh 


def R_mesh_to_C(R_mesh):
    vertices = []
    faces = []

    for pt in R_mesh.Vertices:
        vertices.append([pt.X, pt.Y, pt.Z])
        
    for face in R_mesh.Faces:
        if face.IsQuad:
            faces.append([face.A, face.B, face.C, face.D])
        else:
            faces.append([face.A, face.B, face.C]) 
  

    C_mesh = Mesh.from_vertices_and_faces(vertices, faces)
    return C_mesh
  

sc.sticky['polygon_to_R'] = polygon_to_R
sc.sticky['polyline_to_R'] = polyline_to_R
sc.sticky['circle_to_R'] = circle_to_R
sc.sticky['point_to_R'] = point_to_R
sc.sticky['vector_to_R'] = vector_to_R
sc.sticky['line_to_R'] = line_to_R
sc.sticky['plane_to_R'] = plane_to_R
sc.sticky['mesh_to_R'] = mesh_to_R
sc.sticky['R_mesh_to_C'] = R_mesh_to_C
# ---------- end python_3 ----------
tag = TextTag3D(Location=end_2.Start, Text=python_2.txts, Size=Slider(0.1, range=0..1), Justification=7)
item = ListItem(List=join, Index=number_slider, Wrap=True)  # disabled
number_slider_2 = Slider(0, range=0..14)  # disabled
panel = Panel("0.01")  # disabled
pipe = Pipe(Curve=item, Radius=panel, Caps=0)  # disabled
reb = RebuildCurve(Curve=geo, Degree="5", Count=10, Tangents=False)
crv = Curve(reb)
crv_2 = Curve(crv)
crv_3 = Curve(crv)  # disabled
rev = ReverseList(List=crv_2)
item_2 = ListItem(List=crv_3, Index=number_slider_2, Wrap=True)  # disabled
len = Length(Curve=reb)
python_4 = GhPythonScript(contour_curves=crv_2, course_dis="0.06")  # -> out, tempgeo, mesh, text_cur; inputs contour_curves: list of Curve
# ---------- python_4: Python ----------
__author__ = "duch"

import rhinoscriptsyntax as rs
import Rhino.Geometry as rg
import ghpythonlib.components as gh
from compas.datastructures import Mesh
import os

tempgeo = [] # DEBUG
text_cur = [] # DEBUG

mesh = Mesh()
mesh.update_default_vertex_attributes({"row": None, "column": None, "tri": None})

file = os.path.abspath("/Users/duch/Documents/Github/compas_knit/src/cpp_libigl/build/temp/curve_pts.txt")

with open(file, "w+") as i_file:
    for i, crv in enumerate(contour_curves):
        
        # divide the curve by length, get the points on the curve
        length = crv.GetLength()
        seg_count = int(length / course_dis)
        ts = crv.DivideByCount(seg_count, True)
        pts = [crv.PointAt(t) for t in ts] 
        pts = [[pt.X, pt.Y, pt.Z] for pt in pts]
        
        i_file.write(str(pts) + "\n")



for i, crv in enumerate(contour_curves):
    
    # divide the curve by length, get the points on the curve
    length = crv.GetLength()
    seg_count = int(length / course_dis)
    print(seg_count)
    ts = crv.DivideByCount(seg_count, True)
    pts = [crv.PointAt(t) for t in ts] 
    vkeys = []
    
    # add pts on the curve to mesh
    for j, pt in enumerate(pts):
        tempgeo.append(pt)
        vkey = mesh.add_vertex(x=float(pt.X), y=float(pt.Y), z=float(pt.Z))
        mesh.vertex_attributes(vkey, ["row", "column"], [i, j])
        vkeys.append(vkey)
    
    
    # add faces to the mesh
    # this process starting from the second row
    if i > 0:
        ancestor_indices = []
        current_indices = []
        # for pt in the current row, find the closest point in the ancestor row 
        # CAN BE OPTIMISED
        for j, pt in enumerate(pts):
            ancestor_index = gh.ClosestPoint(pt, ancestor_pts)[1]
            ancestor_indices.append(ancestor_index)
        
        # for pt in the ancestor row, find the closest point in the current row
        # CAN BE OPTIMISED
        for j, pt in enumerate(ancestor_pts):
            current_index = gh.ClosestPoint(pt, pts)[1]
            current_indices.append(current_index)
            text_cur.append(str(current_index)) # DEBUG
        
        
        print(ancestor_indices, current_indices)
        
        k = 0
        h = 0
        
        # create faces
        count = 0
        while k < ancestor_seg_count and h < seg_count and count < 150:
            count += 1
            anc_ind = ancestor_indices[h]
            cur_ind = current_indices[k]
            anc_ind_next = ancestor_indices[h+1]
            cur_ind_next = current_indices[k+1]

            if anc_ind <= cur_ind and anc_ind_next <= cur_ind_next and anc_ind_next > anc_ind:
                mesh.add_face([ancestor_vkeys[k], ancestor_vkeys[k+1], vkeys[h+1], vkeys[h]])
                print("1", [ancestor_vkeys[k], ancestor_vkeys[k+1], vkeys[h+1], vkeys[h]])
                
                k += 1 
                h += 1 
                
            elif anc_ind_next == anc_ind:
                # if mesh.edge_length(ancestor_vkeys[k], vkeys[h]) <= course_dis * 2:
                mesh.add_face([ancestor_vkeys[k], vkeys[h+1], vkeys[h]])
                print("2", [ancestor_vkeys[k], vkeys[h+1], vkeys[h]])
                mesh.vertex_attribute(ancestor_vkeys[k], "tri", 0)
                h += 1 
            
            elif anc_ind >= cur_ind and anc_ind_next >= cur_ind_next and cur_ind_next > cur_ind:
                mesh.add_face([ancestor_vkeys[k], ancestor_vkeys[k+1], vkeys[h+1], vkeys[h]])
                print("11", [ancestor_vkeys[k], ancestor_vkeys[k+1], vkeys[h+1], vkeys[h]])
                k += 1 
                h += 1 
            
            elif cur_ind_next == cur_ind:
                # if mesh.edge_length(ancestor_vkeys[k], vkeys[h]) <= course_dis * 2:
                mesh.add_face([ancestor_vkeys[k], ancestor_vkeys[k+1], vkeys[h]])
                print("22", [ancestor_vkeys[k], ancestor_vkeys[h+1], vkeys[h]])
                mesh.vertex_attribute(vkeys[h], "tri", 1)
                k += 1 
            
            '''
            elif cur_ind <= anc_ind and cur_ind <= anc_ind_next and cur_ind_next > anc_ind_next:
            
                # ancestor     k    | k+1
                # current   h | h+1 | h+2
                mesh.add_face([ancestor_vkeys[k], vkeys[h+1], vkeys[h]])
                print("3", [k, h+1, h], [cur_ind, anc_ind_next, anc_ind])
                h += 1 
                
            elif anc_ind <= cur_ind and anc_ind <= cur_ind_next and anc_ind_next > cur_ind_next:
                # ancestor  k | k+1 | k+2
                # current       h   | h+1 
                mesh.add_face([ancestor_vkeys[k], ancestor_vkeys[k+1], vkeys[h]])
                print("4", [k, h+1, h], [cur_ind, cur_ind_next, anc_ind])
                k += 1

            elif cur_ind <= anc_ind and cur_ind <= anc_ind_next:
                # ancestor  k      |   k+1
                # current   h | h+1 | h+2
                mesh.add_face([ancestor_vkeys[k], vkeys[h+1], vkeys[h]])
                print("5", [ancestor_vkeys[k], vkeys[h+1], vkeys[h]])
                k += 1 
            else:
                print("smething")
            '''
        if k < ancestor_seg_count and h == seg_count:
            mesh.add_face([ancestor_vkeys[k], ancestor_vkeys[k+1], vkeys[h]])
            mesh.vertex_attribute(vkeys[h], "tri", 1)
            
        elif k == ancestor_seg_count and h < seg_count:
            mesh.add_face([ancestor_vkeys[k], vkeys[h+1], vkeys[h]])
            mesh.vertex_attribute(ancestor_vkeys[k], "tri", 0)
        
        '''
        # find the start vertex's cloest point in the ancestor row
        start_index_ancestor = gh.ClosestPoint(pts[0], ancestor_pts)[1]
        start_index_current =  gh.ClosestPoint(ancestor_pts[0], pts)[1]
        end_index_ancestor = gh.ClosestPoint(pts[-1], ancestor_pts)[1]
        end_index_current = gh.ClosestPoint(ancestor_pts[-1], pts)[1]

        if start_index_ancestor > start_index_current:
        # situation I: 
        # 0`| 1`| 2`| 3`| 4`|  ancestor row, start_index_ancestor=2
        #         0 | 1 | 2 |  current row, start_index_current=0
            # for k in range(closest_index_ancestor):
            #     mesh.add_face([ancestor_vkeys[k+1], ancestor_vkeys[k], vkeys[0]])
            # for j in range(len(vkeys) - 1):
            #     mesh.add_face([vkeys[j], vkeys[j+1], ancestor_vkeys[j+1+closest_index_ancestor], ancestor_vkeys[j+closest_index_ancestor]])
            raise NotImplementedError("not implemented")
        elif start_index_ancestor < start_index_current:
        # situation II:
        #         0`| 1`| 2`|  ancestor row, start_index_ancestor=0
        # 0 | 1 | 2 | 3 | 4 |  current row, start_index_current=2
            # closest_index = gh.ClosestPoint(ancestor_pts[0], 
            # mesh.vertex_attribute(vkey, "ancestor", ancestor_vkeys[closest_index]+j)
            raise NotImplementedError("not implemented")
        # situation III:
        # 0`| 1`| 2`| 3`| 4`|  ancestor row, start_index_ancestor=0
        # 0 | 1 | 2 | 3 | 4 |  current row, start_index_current=0
        else:
            if ancestor_seg_count < seg_count:
                for k in range(seg_count-1):
                    if k < ancestor_seg_count-1: 
                        mesh.vertex_attribute(vkey, "ancestor", ancestor_vkeys[k])
                        mesh.add_face([vkeys[k], vkeys[k+1], ancestor_vkeys[k+1], ancestor_vkeys[k]])
                    else:
                        mesh.vertex_attribute(vkey, "ancestor", ancestor_vkeys[-1])
                        mesh.add_face([vkeys[k], vkeys[k+1], ancestor_vkeys[-1]])
        '''
                
    
    # save the information of the last row 
    ancestor_seg_count = seg_count
    ancestor_pts = pts
    ancestor_vkeys = vkeys
        

import os
path = os.path.abspath("/Users/duch/Documents/Github/compas_knit/src/cpp_libigl/build/temp/mesh.json")
if not os.path.exists(path):
    # If the file doesn't exist, create a new JSON file
    f = open(path, "w+")
mesh.to_json(path)
# ---------- end python_4 ----------
pt_2 = ConstructPoint(XCoordinate=0, YCoordinate=0, ZCoordinate=0)  # disabled
end_3 = EndPoints(Curve=item_2)  # -> Start, End; disabled
division = Division(A=len, B="0.05")
vec2pt = Vector2Pt(PointA=end_3.Start, PointB=pt_2, Unitize=False)  # -> Vector, Length; disabled
move = Move(Geometry=crv_2, Motion=vec2pt.Vector)  # -> Geometry, Transform; disabled
divide = DivideCurve(Curve=reb, Count=division, Kinks=False)  # -> Points, Tangents, Parameters; disabled
python_5 = GhPythonScript(mesh=python_4.mesh)  # -> out, R_mesh
# ---------- python_5: Python ----------
__author__ = "duchaoyu"

import scriptcontext as sc
import compas

import os

folder = "/Users/duch/Desktop/prototype/shanghai/knitting_pattern"
filename = "mesh1.json"
file = os.path.join(folder, filename)
print(file)
mesh.to_json(file)


R_mesh = sc.sticky['mesh_to_R'](mesh)
# ---------- end python_5 ----------
pt_3 = Point(python_4.tempgeo)
medges = MeshEdges(Mesh=python_5.R_mesh)  # -> NakedEdges, InteriorEdges, NonManifoldEdges
demesh = DeconstructMesh(Mesh=python_5.R_mesh)  # -> Vertices, Faces, Colours, Normals
tag_2 = TextTag3D(Location=pt_3, Text=python_4.text_cur, Size=Slider(2.02, range=0..10), Justification=5)  # disabled
python_6 = GhPythonScript(input_mesh=python_4.mesh, start="0")  # -> out, temp_geo; inputs start: Int32; disabled
# ---------- python_6: Python ----------
__author__ = "duch"

import os
import rhinoscriptsyntax as rs
import scriptcontext
import Rhino.Geometry as rg
from itertools import chain
import System.Drawing as sd
import time
start_time = time.time()

mesh = input_mesh.copy()
# mesh.flip_cycles()
temp_geo = []

mesh.delete_vertex(0)

mesh.update_default_vertex_attributes({"checked": False})

min_col = 0
max_col = 0
min_row = 0
max_row = 0
bitmap_dict = {}

# mesh.vertex_attribute(412, "tri", 0)


def halfedge_loop_r_l(mesh, edge):
        """Find all edges on the same loop as the halfedge, in the direction of the halfedge.

        Parameters
        ----------
        edge : tuple[int, int]
            The identifier of the starting edge.

        Returns
        -------
        list[tuple[int, int]]
            The edges on the same loop as the given edge.

        """
        toggle = 0
        
        u, v = edge
        edges = [(u, v)]
        
        if mesh.is_edge_on_boundary(u, v):
            while True:
                nbrs = mesh.vertex_neighbors(v)
                fkey = mesh.halfedge_face(u, v)
                # if fkey is None:
                    # fkey = mesh.halfedge_face(v, u)
                if mesh.vertex_attribute(v, "tri") == toggle:
                    break
                if mesh.vertex_degree(v) == 2:
                    break
                nbrs = mesh.vertex_neighbors(v, ordered=True)
                i = nbrs.index(u)
                u = v
                v = nbrs[i-1]
                # v = nbrs[i - 2]
                edges.append((u, v))
                if v == edges[0][0]:
                    break
                
            return edges
            
        break_v = None
        
        while True:
            count = 2
            fkey = mesh.halfedge_face(u, v)
            if mesh.is_vertex_on_boundary(v) is True:
                break
            if mesh.vertex_attribute(v, "tri") == toggle:
                count = 3 
                if mesh.vertex_attribute(v, "checked") is False:
                    break
            nbrs = mesh.vertex_neighbors(v, ordered=True)
            i = nbrs.index(u)
            u = v
            v = nbrs[(i - count)%len(nbrs)]
            edges.append((u, v))
            if v == edges[0][0]:
                break
                
        if break_v is not None:
            sel_edges = []                  
            for e in edges:
                if e[0] == break_v:
                    break
                sel_edges.append(e)  
        
            return sel_edges
            
        return edges

def halfedge_loop_l_r(mesh, edge):
        """Find all edges on the same loop as the halfedge, in the direction of the halfedge.

        Parameters
        ----------
        edge : tuple[int, int]
            The identifier of the starting edge.

        Returns
        -------
        list[tuple[int, int]]
            The edges on the same loop as the given edge.

        """
        toggle = 1
        u, v = edge
        edges = [(u, v)]
        
        break_v = None
        while True:
            count = 2
            fkey = mesh.halfedge_face(u, v)
            if mesh.is_vertex_on_boundary(v) is True:
                if mesh.is_edge_on_boundary(u, v) is False:
                    break_v = v
                    break
            if mesh.vertex_attribute(v, "tri") == toggle:
                break_v = v
                if mesh.vertex_attribute(v, "checked") is True:
                    break
            nbrs = mesh.vertex_neighbors(v, ordered=True)
            
            i = nbrs.index(u)
            u = v
            v = nbrs[(i + count)%len(nbrs)]
            edges.append((u, v))
            if v == edges[0][0]:
                break
        print("break", break_v)
        if break_v is not None:
            sel_edges = []                  
            for e in edges:
                if e[0] == break_v:
                    break
                sel_edges.append(e)  
        
            return sel_edges
            
        return edges


def check_nbr_dir(mesh, vkey, filter=True):
    # parameters:
    #   mesh: input mesh
    #   vkey: the vertex to check
    #   dir: "l_r or r_l"
    #   filter: optional, whether filter the checked points
    # output: 
    #   list: [weft_nbrs, course_nbrs]
    nbrs = mesh.vertex_neighbors(vkey)
    course_nbrs = []
    wale_nbrs = []

    for nbr in nbrs:    
        if mesh.vertex_attribute(vkey, "row") != mesh.vertex_attribute(nbr, "row"):
            if filter:
                if mesh.vertex_attribute(nbr, "checked") is True:
                    continue
            course_nbrs.append(nbr)
        else:
            if filter:
                if mesh.vertex_attribute(nbr, "checked") is True:
                    continue
            wale_nbrs.append(nbr)
    
    if course_nbrs == []:
        vkey, course_nbr = check_nbr_dir(mesh, wale_nbrs[0], filter=True)
        return vkey, course_nbr
    
    
    course_nbr = course_nbrs[0]
    if len(course_nbrs) == 1:
        if mesh.vertex_attribute(course_nbr, "tri") == 1:
            vkey, course_nbr = check_nbr_dir(mesh, course_nbr, filter=True)
            return vkey, course_nbr
        
    if len(course_nbrs) > 1:    
        if mesh.vertex_attribute(vkey, "tri") == 0:
            for can in course_nbrs:
                if mesh.vertex_attribute(can, "row") > mesh.vertex_attribute(course_nbr, "row"):
                    course_nbr = can
                elif mesh.vertex_attribute(can, "row") == mesh.vertex_attribute(course_nbr, "row"):
                    if mesh.vertex_attribute(can, "column") < mesh.vertex_attribute(course_nbr, "column"):
                        course_nbr = can
        else:
            for can in course_nbrs:
                if mesh.vertex_attribute(can, "row") < mesh.vertex_attribute(course_nbr, "row"):
                    course_nbr = can
                elif mesh.vertex_attribute(can, "row") == mesh.vertex_attribute(course_nbr, "row"):
                    if mesh.vertex_attribute(can, "column") < mesh.vertex_attribute(course_nbr, "column"):
                        course_nbr

    return vkey, course_nbr


def course_r_l(mesh, start, filter=True):
    # parameters:
    #   mesh: input mesh
    #   start: the vertex to start
    #   course_nbr: nbr in the course direction
    # output: 
    #   pts: list of point coordinates (x, y, z)
    start_, nbr = check_nbr_dir(mesh, start, filter=True)

    loop = halfedge_loop_r_l(mesh, (start_, nbr))
    loop_vkeys = chain.from_iterable(loop) # flatten the nested loop
    loop_set = set()
    vkeys = []
    pts = []
    for vkey in loop_vkeys:
        if vkey not in loop_set:
            mesh.vertex_attribute(vkey, "checked", True)
            loop_set.add(vkey)
            vkeys.append(vkey)
            xyz = mesh.vertex_coordinates(vkey)
            pts.append(xyz)
    return vkeys, pts



def course_l_r(mesh, start, filter=True):
    # parameters:
    #   mesh: input mesh
    #   start: the vertex to start
    #   course_nbr: nbr in the course direction
    # output: 
    #   pts: list of point coordinates (x, y, z)
    start_, nbr = check_nbr_dir(mesh, start, filter=True)
    print("debug", start_, nbr)
    
    loop = halfedge_loop_l_r(mesh, (start_, nbr))
    
    loop_set = set()
    loop_vkeys = chain.from_iterable(loop) # flatten the nested loop
    vkeys = []
    pts = []
    for vkey in loop_vkeys:
        if vkey not in loop_set:
            loop_set.add(vkey)
            vkeys.append(vkey)
            
    if start != start_:
        prev = mesh.halfedge_before(*loop[0])
        mid_pt = mesh.edge_midpoint(*prev)
        pts.append(mid_pt)
    
    if mesh.vertex_attribute(loop[-1][1], "tri") == 0:
        if mesh.is_vertex_on_boundary(loop[-1][1]) is False:   
            loop = loop[:-1]
        
    for edge in loop:
        next = mesh.halfedge_after(*edge)
        mid_pt = mesh.edge_midpoint(*next)
        pts.append(mid_pt)

    return vkeys, pts

location = [0, 0]

count = 0 
while True and count < 90:
    count += 1

    # right to left
    # --------------
    # find the neighbour
    
    odd_vkeys, odd_pts = course_r_l(mesh, start, filter=True)
    even_pts_r = [rg.Point3d(x=xyz[0], y=xyz[1], z=xyz[2]) for xyz in odd_pts]
    temp_geo.extend(even_pts_r) 
    print("r-l", odd_vkeys)


    # left to right
    # --------------
    # find the neighbour
    
    even_vkeys, even_pts = course_l_r(mesh, odd_vkeys[-1], filter=True)
    even_pts_r = [rg.Point3d(x=xyz[0], y=xyz[1], z=xyz[2]) for xyz in even_pts]
    temp_geo.extend(even_pts_r) 
    print("l-r", even_vkeys)
    
    
    
    start = even_vkeys[-1]
    print("start", start)
    

    if time.time() - start_time > 10: # 1 minute limit
        raise Exception("time's up!")


"""
temp_geo.pop(-1)

loop = mesh.edge_loop((8, 23))
loop_vkeys = chain.from_iterable(loop) # flatten the nested loop
loop_set = set()
vkeys = []
pts = []
for vkey in loop_vkeys:
    if vkey not in loop_set:
        mesh.vertex_attribute(vkey, "checked", True)
        loop_set.add(vkey)
        vkeys.append(vkey)
        xyz = mesh.vertex_coordinates(vkey)
        pts.append(xyz)
even_pts_r = [rg.Point3d(x=xyz[0], y=xyz[1], z=xyz[2]) for xyz in pts]
temp_geo.extend(even_pts_r)
"""
# ---------- end python_6 ----------
item_3 = ListItem(List=python_6.temp_geo, Index=Slider(4, range=0..1000), Wrap=True)
data = Data(python_4.mesh)
pline = PolyLine(Vertices=python_6.temp_geo, Closed=False)
end_4 = EndPoints()  # -> Start, End

# ----
# edges
toggle = BooleanToggle(True)  # disabled
python_7 = GhPythonScript(showedgelabels=toggle)  # -> R_m_points, edgelabels; inputs showedgelabels: Boolean; disabled
# ---------- python_7: Python ----------
__author__ = "duchaoyu"

import rhinoscriptsyntax as rs
import scriptcontext as sc

R_m_points = []
edgelabels = []

# access edges
for u, v in mesh.edges(): # u, v: two vertices that the edge connect
    m_xyz = mesh.edge_midpoint(u, v) # middle point of the edge
    R_m_point = sc.sticky['point_to_R'](m_xyz)
    R_m_points.append(R_m_point)
    
    if showedgelabels:
        edgelabels.append("{}-{}".format(u, v))
# ---------- end python_7 ----------
number_slider_3 = Slider(0.22, range=0..1)  # disabled
swatch = ColourSwatch(SwatchColor=RGB(255, 0, 0))  # disabled
pt_4 = Point(python_7.R_m_points)  # disabled
tag_3 = TextTag3D(Location=python_7.R_m_points, Text=python_7.edgelabels, Size=number_slider_3, Colour=swatch, Justification=5)  # disabled

toggle_2 = BooleanToggle(True)  # disabled

# ----
# half-edges
toggle_3 = BooleanToggle(True)  # disabled
python_8 = GhPythonScript(showhalfedges=toggle_3, hideNonefaces=toggle_2)  # -> R_points, R_vectors; inputs showhalfedges: Boolean, hideNonefaces: Boolean; disabled
# ---------- python_8: Python ----------
__author__ = "duchaoyu"

import scriptcontext as sc
import System.Drawing as sd
from compas.geometry import Line, Frame, Scale, offset_line

R_points = []
R_vectors = []

distance = 0.1
shrink = 0.7

if showhalfedges:
    for (u, v) in mesh.edges():
        halfedges = [(u, v), (v, u)]
        for (u, v) in halfedges: 
            fkey = mesh.halfedge_face(u, v)
            
            if hideNonefaces: 
                if fkey is None:
                    continue
            
            if fkey is None:
                normal = mesh.face_normal(mesh.halfedge_face(v, u))
            else:
                normal = mesh.face_normal(fkey)
                
            a, b = mesh.edge_coordinates(u, v)
            line = Line(*offset_line((a, b), distance, normal))
            frame = Frame(line.midpoint, [1, 0, 0], [0, 1, 0])
            scale = Scale.from_factors([shrink, shrink, shrink], frame=frame)
            line.transform(scale)
            dir = [(b - a) for a, b in zip(line[0], line[1])]
            
            R_points.append(sc.sticky['point_to_R'](line[0]))
            R_vectors.append(sc.sticky['vector_to_R'](dir))
# ---------- end python_8 ----------
pt_5 = Point(python_8.R_points)  # disabled
vec = Vector(python_8.R_vectors)  # disabled
vdis = VectorDisplay(Anchor=pt_5, Vector=vec)  # disabled

python_9 = GhPythonScript()  # -> out, mesh, R_mesh; disabled
# ---------- python_9: Python ----------
__author__ = "duchaoyu"

import scriptcontext as sc
from compas.datastructures import Mesh
import os

folder = "/Users/duch/Library/Containers/com.tencent.xinWeChat/Data/Library/Application Support/com.tencent.xinWeChat/2.0b4.0.9/c32ba60b0e0c097af1f49a1fd3ffcc42/Message/MessageTemp/0a4dca4fe97d182b230a6dfbca2d3f7c/File"
filename = "mesh1.json"
file = os.path.join(folder, filename)
mesh = Mesh.from_json(file)



R_mesh = sc.sticky['mesh_to_R'](mesh)
# ---------- end python_9 ----------
mesh = Mesh(<mesh referenced from the Rhino model>)  # disabled
python_10 = GhPythonScript()  # -> Out, A; disabled
medges_2 = MeshEdges(Mesh=mesh)  # -> NakedEdges, InteriorEdges, NonManifoldEdges; disabled
python_11 = GhPythonScript(mesh=python_9.mesh)  # -> out, mesh, R_mesh; disabled
# ---------- python_11: Python ----------
__author__ = "duch"

import rhinoscriptsyntax as rs
from itertools import chain
import os
import scriptcontext as sc

loop = mesh.edge_loop((0, 2))
loop_vkeys = chain.from_iterable(loop) # flatten the nested loop




loop_set = set()
for vkey in loop_vkeys:
    if vkey not in loop_set:
        loop_set.add(vkey)
        
loop_set_list = list(loop_set)
for vkey in loop_set_list:
    mesh.vertex_attribute(vkey, "row", -1)
    col = mesh.vertex_attribute(vkey, "column")
    mesh.vertex_attribute(vkey, "column", col+1)




# mesh.delete_face(1876)
# mesh.delete_face(1877)
# mesh.add_face([1950, 1875, 1876, 1951][::-1])
delete_faces = []

for (u, v) in mesh.edges():
    f1 = mesh.halfedge_face(u, v)
    f2 = mesh.halfedge_face(v, u)
    if f1 is not None and f2 is not None:
        f1_vkeys = mesh.face_vertices(f1)
        f2_vkeys = mesh.face_vertices(f2)
        if len(f1_vkeys) == 3 and len(f2_vkeys) == 3:
            u_row = mesh.vertex_attribute(u, "row")
            v_row = mesh.vertex_attribute(v, "row")
            if  u_row!= v_row: 
                u_after = mesh.face_vertex_after(f2, u, 1)
                u_after_row = mesh.vertex_attribute(u_after, "row")
                v_after = mesh.face_vertex_after(f1, v, 1)
                v_after_row = mesh.vertex_attribute(v_after, "row")
                if (u_row == u_after_row and v_row == v_after_row) or (u_row ==v_after_row and v_row == u_after_row):
                    print(u, v)
                    face = [u, u_after, v, v_after]
                    mesh.add_face(face)
                    delete_faces.extend([f1, f2])
            
for f in delete_faces:
    mesh.delete_face(f)

folder = "/Users/duch/Library/Containers/com.tencent.xinWeChat/Data/Library/Application Support/com.tencent.xinWeChat/2.0b4.0.9/c32ba60b0e0c097af1f49a1fd3ffcc42/Message/MessageTemp/0a4dca4fe97d182b230a6dfbca2d3f7c/File"

filename_out = "mesh1_fix.json"
file_out = os.path.join(folder, filename_out)
mesh.to_json(file_out)
R_mesh = sc.sticky['mesh_to_R'](mesh)
# ---------- end python_11 ----------
medges_3 = MeshEdges(Mesh=python_11.R_mesh)  # -> NakedEdges, InteriorEdges, NonManifoldEdges; disabled
line = Line(medges_2.NakedEdges)  # disabled
python_12 = GhPythonScript(mesh=python_11.mesh)  # -> out, mesh, points; disabled
# ---------- python_12: Python ----------
__author__ = "duch"

import scriptcontext as sc

left = 1
right = 0


points = []

for fkey in mesh.faces():
    fvkeys = mesh.face_vertices(fkey)
    if len(fvkeys) == 3:
        row0 = mesh.vertex_attribute(fvkeys[0], "row")
        row1 = mesh.vertex_attribute(fvkeys[1], "row")
        row2 = mesh.vertex_attribute(fvkeys[2], "row")
        vset = set([row0, row1, row2])
        if len(vset) != 2:
            raise ValueError("something wrong")
        if row0 == row1:
            points.append(mesh.vertex_coordinates(fvkeys[2]))
            if row2 > row0:
                mesh.vertex_attribute(fvkeys[2], "tri", right)
            else:
                mesh.vertex_attribute(fvkeys[2], "tri", left)
        elif row1 == row2:
            points.append(mesh.vertex_coordinates(fvkeys[0]))
            if row0 > row1:
                mesh.vertex_attribute(fvkeys[0], "tri", right)
            else:
                mesh.vertex_attribute(fvkeys[0], "tri", left)
        elif row0 == row2:
            points.append(mesh.vertex_coordinates(fvkeys[1]))
            if row1 > row0:
                mesh.vertex_attribute(fvkeys[1], "tri", right)
            else:
                mesh.vertex_attribute(fvkeys[1], "tri", left)
                
points = [sc.sticky['point_to_R'](pt) for pt in points]
# ---------- end python_12 ----------
panel_2 = Panel("0")  # disabled
join_2 = JoinCurves(Curves=line, Preserve=False)  # disabled
number_slider_4 = Slider(4, range=0..1000)  # disabled
panel_3 = Panel("0.002")  # disabled
python_13 = GhPythonScript(input_mesh=python_12.mesh, start=panel_2)  # -> out, temp_geo; inputs start: Int32; disabled
# ---------- python_13: Python ----------
__author__ = "duch"

import os
import rhinoscriptsyntax as rs
import scriptcontext
import Rhino.Geometry as rg
from itertools import chain
import System.Drawing as sd
import time
start_time = time.time()

mesh = input_mesh.copy()
# mesh.flip_cycles()
temp_geo = []




mesh.update_default_vertex_attributes({"checked": False})

min_col = 0
max_col = 0
min_row = 0
max_row = 0
bitmap_dict = {}

# mesh.vertex_attribute(412, "tri", 0)
left = 1
right = 0

def halfedge_loop_r_l(mesh, edge):
        """Find all edges on the same loop as the halfedge, in the direction of the halfedge.

        Parameters
        ----------
        edge : tuple[int, int]
            The identifier of the starting edge.

        Returns
        -------
        list[tuple[int, int]]
            The edges on the same loop as the given edge.

        """
        
        u, v = edge
        edges = [(u, v)]
        
        if mesh.is_edge_on_boundary(u, v):
            while True:
                nbrs = mesh.vertex_neighbors(v)
                fkey = mesh.halfedge_face(u, v)
                # if fkey is None:
                    # fkey = mesh.halfedge_face(v, u)
                if mesh.vertex_attribute(v, "tri") == right:
                    break
                if mesh.vertex_degree(v) == 2:
                    break
                nbrs = mesh.vertex_neighbors(v, ordered=True)
                i = nbrs.index(u)
                u = v
                v = nbrs[i-1]
                # v = nbrs[i - 2]
                edges.append((u, v))
                if v == edges[0][0]:
                    break
                
            return edges
            
        break_v = None
        
        while True:
            count = 2
            fkey = mesh.halfedge_face(u, v)
            if mesh.is_vertex_on_boundary(v) is True:
                break
            if mesh.vertex_attribute(v, "tri") == right:
                count = 3 
                if mesh.vertex_attribute(v, "checked") is False:
                    break
            nbrs = mesh.vertex_neighbors(v, ordered=True)
            i = nbrs.index(u)
            u = v
            v = nbrs[(i - count)%len(nbrs)]
            edges.append((u, v))
            if v == edges[0][0]:
                break
                
        if break_v is not None:
            sel_edges = []                  
            for e in edges:
                if e[0] == break_v:
                    break
                sel_edges.append(e)  
        
            return sel_edges
            
        return edges

def halfedge_loop_l_r(mesh, edge):
        """Find all edges on the same loop as the halfedge, in the direction of the halfedge.

        Parameters
        ----------
        edge : tuple[int, int]
            The identifier of the starting edge.

        Returns
        -------
        list[tuple[int, int]]
            The edges on the same loop as the given edge.

        """
        u, v = edge
        edges = [(u, v)]
        
        break_v = None
        while True:
            count = 2
            fkey = mesh.halfedge_face(u, v)
            if mesh.is_vertex_on_boundary(v) is True:
                if mesh.is_edge_on_boundary(u, v) is False:
                    break_v = v
                    break
            if mesh.vertex_attribute(v, "tri") == left:
                break_v = v
                if mesh.vertex_attribute(v, "checked") is True:
                    break
            nbrs = mesh.vertex_neighbors(v, ordered=True)
            
            i = nbrs.index(u)
            u = v
            v = nbrs[(i + count)%len(nbrs)]
            edges.append((u, v))
            if v == edges[0][0]:
                break
                
        print("break", break_v)
        if break_v is not None:
            sel_edges = []                  
            for e in edges:
                if e[0] == break_v:
                    break
                sel_edges.append(e)  
        
            return sel_edges
            
        return edges


def check_nbr_dir(mesh, vkey, filter=True):
    # parameters:
    #   mesh: input mesh
    #   vkey: the vertex to check
    #   dir: "l_r or r_l"
    #   filter: optional, whether filter the checked points
    # output: 
    #   list: [weft_nbrs, course_nbrs]
    nbrs = mesh.vertex_neighbors(vkey)
    course_nbrs = []
    wale_nbrs = []

    for nbr in nbrs:    
        if mesh.vertex_attribute(vkey, "row") != mesh.vertex_attribute(nbr, "row"):
            if filter:
                if mesh.vertex_attribute(nbr, "checked") is True:
                    continue
            course_nbrs.append(nbr)
        else:
            if filter:
                if mesh.vertex_attribute(nbr, "checked") is True:
                    continue
            wale_nbrs.append(nbr)
    
    print(vkey, wale_nbrs, course_nbrs)
    
    if course_nbrs == []:
        vkey, course_nbr = check_nbr_dir(mesh, wale_nbrs[0], filter=True)
        return vkey, course_nbr
    
    
    course_nbr = course_nbrs[0]
    if len(course_nbrs) == 1:
        if mesh.vertex_attribute(course_nbr, "tri") == right:
            vkey, course_nbr = check_nbr_dir(mesh, course_nbr, filter=True)
            # print(course_nbr, "TRIDEBUG", mesh.vertex_attribute(course_nbr, "tri"))
            return vkey, course_nbr
            
            
        
    if len(course_nbrs) > 1:    
        if mesh.vertex_attribute(vkey, "tri") == left:
            for can in course_nbrs:
                if mesh.vertex_attribute(can, "row") > mesh.vertex_attribute(course_nbr, "row"):
                    course_nbr = can
                elif mesh.vertex_attribute(can, "row") == mesh.vertex_attribute(course_nbr, "row"):
                    if mesh.vertex_attribute(can, "column") < mesh.vertex_attribute(course_nbr, "column"):
                        course_nbr = can
        else:
            for can in course_nbrs:
                if mesh.vertex_attribute(can, "row") < mesh.vertex_attribute(course_nbr, "row"):
                    course_nbr = can
                elif mesh.vertex_attribute(can, "row") == mesh.vertex_attribute(course_nbr, "row"):
                    if mesh.vertex_attribute(can, "column") < mesh.vertex_attribute(course_nbr, "column"):
                        course_nbr = can

    return vkey, course_nbr


def course_r_l(mesh, start, filter=True):
    # parameters:
    #   mesh: input mesh
    #   start: the vertex to start
    #   course_nbr: nbr in the course direction
    # output: 
    #   pts: list of point coordinates (x, y, z)
    start_, nbr = check_nbr_dir(mesh, start, filter=True)

    loop = halfedge_loop_r_l(mesh, (start_, nbr))
    
    if start == 105:
        loop2 = halfedge_loop_r_l(mesh, (1162, 1233))
        loop += loop2
    if start == 2168:
        loop2 = halfedge_loop_r_l(mesh, (2238, 2259))
        loop += loop2
    if start == 2193:
        loop2 = halfedge_loop_r_l(mesh, (2292, 2304))
        loop += loop2
    
    loop_vkeys = chain.from_iterable(loop) # flatten the nested loop
        
    loop_set = set()
    vkeys = []
    pts = []
    for vkey in loop_vkeys:
        if vkey not in loop_set:
            mesh.vertex_attribute(vkey, "checked", True)
            loop_set.add(vkey)
            vkeys.append(vkey)
            xyz = mesh.vertex_coordinates(vkey)
            pts.append(xyz)
    return vkeys, pts



def course_l_r(mesh, start, filter=True):
    # parameters:
    #   mesh: input mesh
    #   start: the vertex to start
    #   course_nbr: nbr in the course direction
    # output: 
    #   pts: list of point coordinates (x, y, z)
    start_, nbr = check_nbr_dir(mesh, start, filter=True)
    print("debug", start, start_, nbr, mesh.vertex_attribute(start, "tri"))
    
    loop = halfedge_loop_l_r(mesh, (start_, nbr))
    
    loop_set = set()
    loop_vkeys = chain.from_iterable(loop) # flatten the nested loop
    vkeys = []
    pts = []
    for vkey in loop_vkeys:
        if vkey not in loop_set:
            loop_set.add(vkey)
            vkeys.append(vkey)
    """
    if mesh.vertex_attribute(start, "tri") == right:
        if mesh.is_vertex_on_boundary(start) is True:
            mid_pt = mesh.edge_midpoint(start, vkeys[1])
            pts.append(mid_pt)
    """
    
    if start != start_:
        prev = mesh.halfedge_before(*loop[0])
        mid_pt = mesh.edge_midpoint(*prev)
        pts.append(mid_pt)
    
    if mesh.vertex_attribute(loop[-1][1], "tri") == left:
        if mesh.is_vertex_on_boundary(loop[-1][1]) is False:
            loop = loop[:-1]
        else:
            fkey = mesh.halfedge_face(*loop[-1])
            if len(mesh.face_vertices(fkey)) == 3:
                loop = loop[:-1]
        
    for edge in loop:
        next = mesh.halfedge_after(*edge)
        mid_pt = mesh.edge_midpoint(*next)
        pts.append(mid_pt)

    return vkeys, pts

location = [0, 0]

count = 0 
while True and count < 111:
    count += 1

    # right to left
    # --------------
    # find the neighbour
    
    odd_vkeys, odd_pts = course_r_l(mesh, start, filter=True)
    
    start = odd_vkeys[-1]
    
    
    if mesh.vertex_attribute(odd_vkeys[0], "tri") == left and mesh.is_vertex_on_boundary(odd_vkeys[0]) is False:
        odd_vkeys = odd_vkeys[1:]
        odd_pts = odd_pts[1:]    
    
    if mesh.vertex_attribute(odd_vkeys[-1], "tri") == right and mesh.is_vertex_on_boundary(odd_vkeys[-1]) is False:
        odd_vkeys = odd_vkeys[:-1]
        odd_pts = odd_pts[:-1]    
    
    
    odd_pts_r = [rg.Point3d(x=xyz[0], y=xyz[1], z=xyz[2]) for xyz in odd_pts]
    temp_geo.extend(odd_pts_r) 
    print("r-l", odd_vkeys)

    # bitmap
    for _ in range(len(odd_pts)):
        bitmap_dict[tuple(location)] = 1
        location[0] -= 1
    if location[0] <= min_col:
        min_col = location[0]
    # go to the next row
    max_row += 1
    location[0] += 1
    location[1] += 1


    # left to right
    # --------------
    # find the neighbour
    
    even_vkeys, even_pts = course_l_r(mesh, start, filter=True)
    start = even_vkeys[-1]
        
    
    
    even_pts_r = [rg.Point3d(x=xyz[0], y=xyz[1], z=xyz[2]) for xyz in even_pts]
    temp_geo.extend(even_pts_r) 
    print("l-r", even_vkeys)
    
    # bitmap
    for _ in range(len(even_pts)):
        bitmap_dict[tuple(location)] = 1
        location[0] += 1
    if location[0] >= max_col:
        max_col = location[0]
    max_row += 1
    location[0] -= 1
    location[1] += 1


    

    if time.time() - start_time > 10: # 1 minute limit
        raise Exception("time's up!")


# add last few lines.... ===================================
loop = mesh.edge_loop((144,145))
loop_vkeys = chain.from_iterable(loop) # flatten the nested loop
loop_set = set()
vkeys = []
pts = []
for vkey in loop_vkeys:
    if vkey not in loop_set:
        mesh.vertex_attribute(vkey, "checked", True)
        loop_set.add(vkey)
        vkeys.append(vkey)
        xyz = mesh.vertex_coordinates(vkey)
        pts.append(xyz)
even_pts_r = [rg.Point3d(x=xyz[0], y=xyz[1], z=xyz[2]) for xyz in pts]
temp_geo.extend(even_pts_r) 

# bitmap
for _ in range(len(pts)):
    bitmap_dict[tuple(location)] = 1
    location[0] -= 1
if location[0] <= min_col:
    min_col = location[0]
# go to the next row
max_row += 1
# location[0] += 1
location[1] += 1

loop = mesh.edge_loop((2341,2336))
pts = []

for edge in loop:
    next = mesh.halfedge_after(*edge)
    mid_pt = mesh.edge_midpoint(*next)
    pts.append(mid_pt)
    
odd_pts_r = [rg.Point3d(x=xyz[0], y=xyz[1], z=xyz[2]) for xyz in pts]
temp_geo.extend(odd_pts_r) 

# bitmap
for _ in range(len(pts)):
    bitmap_dict[tuple(location)] = 1
    location[0] += 1
if location[0] >= max_col:
    max_col = location[0]
max_row += 1
# location[0] -= 1
location[1] += 1

# end of add last few lines.... ===================================

print(max_row, min_row, max_col, min_col)
# print(bitmap_dict)

directory = "/Users/duch/Desktop"
output_path = os.path.join(directory, 'knit.bmp')

# initiate the size of the bitmap
rows = max_row-min_row
columns = max_col-min_col
print(rows, columns)
bm = sd.Bitmap(columns + 1, rows + 1)

# color the bitmap to all White
for i in range(columns+1):
    for j in range(rows+1):
        bm.SetPixel(i,j,sd.Color.White)

# black
for (loc, val) in bitmap_dict.items():
    print(loc[0] + columns, loc[1])
    bm.SetPixel(loc[0] + columns, loc[1],sd.Color.Black)
    

bm.Save(output_path, sd.Imaging.ImageFormat.Bmp)
# ---------- end python_13 ----------
pipe_2 = Pipe(Curve=join_2, Radius=panel_3, Caps=0)  # disabled
item_4 = ListItem(List=python_13.temp_geo, Index=number_slider_4, Wrap=True)  # disabled
pline_2 = PolyLine(Vertices=python_13.temp_geo, Closed=False)  # disabled
end_5 = EndPoints()  # -> Start, End; disabled
swatch_2 = ColourSwatch(SwatchColor=RGB(55, 0, 0))  # disabled
swatch_3 = ColourSwatch(SwatchColor=RGB(55, 0, 0))  # disabled

# ----
# vertices
toggle_4 = BooleanToggle(True)

python_14 = GhPythonScript(mesh=data, showvertexlabels=toggle_4)  # -> R_points, vertexlabels; inputs showvertexlabels: Boolean
# ---------- python_14: Python ----------
__author__ = "duchaoyu"

import scriptcontext as sc

R_points = []
vertexlabels = []

# access vertices
for vkey in mesh.vertices(): # vkey: vertex identifiers
    xyz = mesh.vertex_coordinates(vkey) # vertex coordinates: [x, y, z]
    point = sc.sticky['point_to_R'](xyz) # convert data to Rhino point
    R_points.append(point)
    
    if showvertexlabels:
        vertexlabels.append(str(vkey))
# ---------- end python_14 ----------

pt_6 = Point(python_14.R_points)
tag_4 = TextTag3D(
    Location=python_14.R_points,
    Text=python_14.vertexlabels,
    Size=Slider(0.03, range=0..1),
    Colour=ColourSwatch(SwatchColor=RGB(55, 0, 0)),
    Justification=5)

# ----
# faces
toggle_5 = BooleanToggle(False)

python_15 = GhPythonScript(mesh=data, showfacelabels=toggle_5)  # -> R_face_centroids, facelabels; inputs showfacelabels: Boolean
# ---------- python_15: Python ----------
__author__ = "duchaoyu"

import scriptcontext as sc
import System

R_face_centroids = []
facelabels = []

# access faces
for fkey in mesh.faces(): # fkey: face identifiers
    centroid = mesh.face_centroid(fkey) # centroid point of the mesh face: [x, y, z]
    R_centroid = sc.sticky['point_to_R'](centroid) # convert data to Rhino point
    R_face_centroids.append(R_centroid)
    
    if showfacelabels:
        facelabels.append(str(fkey))
# ---------- end python_15 ----------

pt_7 = Point(python_15.R_face_centroids)
tag_5 = TextTag3D(
    Location=python_15.R_face_centroids,
    Text=python_15.facelabels,
    Size=Slider(0.22, range=0..1),
    Colour=ColourSwatch(SwatchColor=RGB(0, 255, 255)),
    Justification=5)

# ----
# vertex property check
toggle_6 = BooleanToggle(True)  # disabled
number_slider_5 = Slider(0.77, range=0..1)  # disabled

python_16 = GhPythonScript(mesh=python_11.mesh, showvertexlabels=toggle_6)  # -> R_points, vertexlabels; inputs showvertexlabels: Boolean; disabled
# ---------- python_16: Python ----------
__author__ = "duchaoyu"

import scriptcontext as sc

R_points = []
vertexlabels = []

# access vertices
for vkey in mesh.vertices(): # vkey: vertex identifiers
    xyz = mesh.vertex_coordinates(vkey) # vertex coordinates: [x, y, z]
    point = sc.sticky['point_to_R'](xyz) # convert data to Rhino point
    R_points.append(point)
    
    if showvertexlabels:
        # vertexlabels.append(str(mesh.vertex_attribute(vkey, "column"))) 
        vertexlabels.append(str(mesh.vertex_attribute(vkey, "column")))
# ---------- end python_16 ----------
python_17 = GhPythonScript(mesh=python_11.mesh, showvertexlabels=toggle_6)  # -> R_points, vertexlabels; inputs showvertexlabels: Boolean; disabled
# ---------- python_17: Python ----------
__author__ = "duchaoyu"

import scriptcontext as sc

R_points = []
vertexlabels = []

# access vertices
for vkey in mesh.vertices(): # vkey: vertex identifiers
    xyz = mesh.vertex_coordinates(vkey) # vertex coordinates: [x, y, z]
    point = sc.sticky['point_to_R'](xyz) # convert data to Rhino point
    R_points.append(point)
    
    if showvertexlabels:
        # vertexlabels.append(str(mesh.vertex_attribute(vkey, "column"))) 
        vertexlabels.append(str(mesh.vertex_attribute(vkey, "row")))
# ---------- end python_17 ----------

number_slider_6 = Slider(0.77, range=0..1)  # disabled
pt_8 = Point(python_17.R_points)  # disabled
tag_6 = TextTag3D(Location=python_17.R_points, Text=python_17.vertexlabels, Size=number_slider_6, Colour=swatch_3, Justification=5)  # disabled

pt_9 = Point(python_16.R_points)  # disabled
tag_7 = TextTag3D(Location=python_16.R_points, Text=python_16.vertexlabels, Size=number_slider_5, Colour=swatch_2, Justification=5)  # disabled
